# Grasshopper definition 01_.gh (Grasshopper 1.0.7)

lenght = GetNumber(
    Slider(36, range=0..100),
    AtLeast=1,
    AtMost=1,
    Maximum=1.797693135e+308,
    Minimum=-1.797693135e+308,
    TreeAccess=False,
    set_icon=True)
radius = GetNumber(
    Slider(100, range=0..100),
    AtLeast=1,
    AtMost=1,
    Maximum=1.797693135e+308,
    Minimum=-1.797693135e+308,
    TreeAccess=False,
    set_icon=True)
n_elements = GetNumber(
    Slider(57, range=0..100),
    AtLeast=1,
    AtMost=1,
    Maximum=1.797693135e+308,
    Minimum=-1.797693135e+308,
    TreeAccess=False,
    set_icon=True)
cir = Circle(Plane=PlaneXY(0, 0, 0), Radius=radius, set_icon=True)
X = GetNumber(
    Slider(2, range=0..10),
    AtLeast=1,
    AtMost=1,
    Maximum=1.797693135e+308,
    Minimum=-1.797693135e+308,
    TreeAccess=False,
    set_icon=True)
A = GetNumber("90", AtLeast=1, AtMost=1, Maximum=1.797693135e+308, Minimum=-1.797693135e+308, TreeAccess=False, set_icon=True)
factor = GetNumber("2", AtLeast=1, AtMost=1, Maximum=1.797693135e+308, Minimum=-1.797693135e+308, TreeAccess=False, set_icon=True)
divide = DivideCurve(Curve=reparameterize(cir), Count=n_elements, Kinks=False, set_icon=True)  # -> Points, Tangents, Parameters
rad = Radians(Degrees=A, set_icon=True)
pi = Pi(Factor=factor, set_icon=True)
Z = UnitZ(Factor=1, set_icon=True)
vrot = Rotate(Vector=Z, Axis=divide.Tangents, Angle=rad, set_icon=True)
multiplication = Multiplication(A=pi, B=X, set_icon=True)
line = LineSDL(Start=divide.Points, Direction=vrot, Length=lenght, set_icon=True)
remap = RemapNumbers(Value=divide.Parameters, Source=Domain(0, 1), Target=multiplication, set_icon=True)  # -> Mapped, Clipped
rot3d = Rotate3D(Geometry=line, Angle=remap.Mapped, Center=divide.Points, Axis=divide.Tangents, set_icon=True)  # -> Geometry, Transform
end = EndPoints(Curve=rot3d.Geometry, set_icon=True)  # -> Start, End
intcrv = Interpolate(Vertices=end.End, Degree=3, Periodic=True, KnotStyle=1, set_icon=True)  # -> Curve, Length, Domain
intcrv_2 = Interpolate(Vertices=divide.Points, Degree=3, Periodic=True, KnotStyle=1, set_icon=True)  # -> Curve, Length, Domain
merge = Merge(Data1=rot3d.Geometry, Data2=intcrv.Curve, Data3=intcrv_2.Curve, set_icon=True)
context_bake = ContextBake(Geometry=merge, set_icon=True)
